# Grasshopper definition ghtest01.gh (Grasshopper 1.0.8)

# ----
# toggle the steps the see the animation changes of the lamp building from bottom to top
steps = Slider(40, range=0..40)

height = Slider(2, range=0..3)
affection = Curve(<curve referenced from the Rhino model>)
# Each Emotion Are given a predefined base_crv, which are plugged into the python file to generate shape
joy = Curve(<curve referenced from the Rhino model>)
calmness = Curve(<curve referenced from the Rhino model>)
pride = Curve(<curve referenced from the Rhino model>)
fear = Curve(<curve referenced from the Rhino model>)
sadness = Curve(<curve referenced from the Rhino model>)
disgust = Curve(<curve referenced from the Rhino model>)

# ----
# Python file: valence-arosal timeline csv file are linked here
path = FilePath("/Users/sijiama/Desktop/MachineAes/luminote/valence_arousal_timeline.csv")

series = Series(Start="0", Step=height, Count=steps)
Z = UnitZ(Factor=series)
multiplication = Multiplication(A=Z, B=series)
move = Move(Geometry=affection, Motion=multiplication)  # -> Geometry, Transform
file = ReadFile(File=path, PerLineParse=True)
file_2 = ReadFile(File=path, PerLineParse=True)
py3 = Python3Script(lines=file)  # -> out, a; inputs lines: list
# ---------- py3: Python ----------
valence_values = []

for i, line in enumerate(lines):
    if i == 0:
        continue  # skip header

    parts = line.strip().split(",")

    if len(parts) >= 2:
        try:
            valence = float(parts[1])  # Index 1 = Valence column
            valence_values.append(valence)
        except:
            continue  # skip invalid values

a = valence_values
# ---------- end py3 ----------
py3_2 = Python3Script(lines=file_2)  # -> out, a; inputs lines: list
# ---------- py3_2: Python ----------
arousal_values = []

for i, line in enumerate(lines):
    if i == 0:
        continue  # skip header

    parts = line.strip().split(",")
    
    if len(parts) == 3:
        try:
            arousal = float(parts[2])
            arousal_values.append(arousal)
        except:
            continue  # skip invalid values

a = arousal_values
# ---------- end py3_2 ----------
panel = Panel(py3.a)
panel_2 = Panel(py3_2.a)
py3_3 = Python3Script(
    base_crv=affection,
    scale=Slider(13, range=0..20),
    arousal=py3_2.a,
    z_vals=series,
    noise_amp=Slider(0.784, range=0..20),
    noise_freq=Slider(0.06, range=0..1),
    divs=Slider(60, range=0..60))  # -> out, a; inputs arousal: list, z_vals: list
# ---------- py3_3: Python ----------
import Rhino.Geometry as rg
import math
import rhinoscriptsyntax as rs

crv_geom = rs.coercecurve(base_crv)  # Convert Guid to Curve

# Simple fake Perlin-style 1D noise
def perlin1d(x):
    return math.sin(x * 1.73) * math.sin(x * 0.47 + 2)

deformed_curves = []

if not z_vals or not arousal or base_crv is None:
    a = []
else:
    for idx, z in enumerate(z_vals):
        if idx >= len(arousal):
            break

        base_radius = float(arousal[idx]) * scale
        crv = crv_geom.DuplicateCurve()
        center = rg.AreaMassProperties.Compute(crv).Centroid

        # Scale from center
        scale_xform = rg.Transform.Scale(center, base_radius)
        crv.Transform(scale_xform)

        t_vals = crv.DivideByCount(int(divs), True)
        if not t_vals:
            continue

        points = []
        for i, t in enumerate(t_vals):
            pt = crv.PointAt(t)
            vec = pt - center
            if vec.IsTiny(): continue
            vec.Unitize()

            noise_val = perlin1d(i * noise_freq + z * 0.03) * noise_amp
            new_pt = pt + vec * noise_val
            points.append(new_pt)

        if len(points) > 1:
            interp = rg.Curve.CreateInterpolatedCurve(points + [points[0]], 3)
            interp.Translate(rg.Vector3d(0, 0, z))
            deformed_curves.append(interp)

    a = deformed_curves
# ---------- end py3_3 ----------
panel_3 = Panel(py3_3.a)
loft = Loft(Curves=py3_3.a, Options={Adjust=False, Closed=False, LoftEnds=0, LoftSimp=0, LoftType=0, Rebuild=10, Refit=0.01})
cap = CapHoles(Brep=loft)
remap = RemapNumbers(Value=py3.a, Source="0", Target="1")  # -> Mapped, Clipped
python = Python3Script(
    base_crv=affection,
    scale=Slider(4.25, range=0..20),
    valence=remap.Mapped,
    z_vals=series,
    amp_pleasant=Slider(1, range=0..10),
    amp_neutral=Slider(0.5, range=0..10),
    amp_unpleasant=Slider(0.6, range=0..10),
    freq_pleasant=Slider(0.3, range=0..1),
    freq_unpleasant=Slider(1.2, range=0..10),
    freq_neutral=Slider(0, range=0..10),
    divs=Slider(60, range=0..60))  # -> out, a; inputs valence: list, z_vals: list
# ---------- python: Python ----------
import Rhino.Geometry as rg
import rhinoscriptsyntax as rs
import math

# Fake Perlin-style 1D noise
def perlin1d(x):
    return math.sin(x * 1.73) * math.sin(x * 0.47 + 2)

# Hardcoded valence thresholds
threshold_pleasant = 0.3
threshold_unpleasant = -0.3

deformed_curves = []

# Convert GUID to actual Curve object
crv_geom = rs.coercecurve(base_crv)

if not z_vals or not valence or crv_geom is None:
    a = []
else:
    for idx, z in enumerate(z_vals):
        if idx >= len(valence):
            break

        val = float(valence[idx])
        base_scale = val * scale  # scale for curve radius

        # Work with a copy of the original curve
        crv = crv_geom.DuplicateCurve()
        center = rg.AreaMassProperties.Compute(crv).Centroid

        # Scale curve by valence
        scale_xform = rg.Transform.Scale(center, base_scale)
        crv.Transform(scale_xform)

        # Choose amp/freq based on valence category
        amp = amp_neutral
        freq = freq_neutral

        if val >= threshold_pleasant:
            amp = amp_pleasant
            freq = freq_pleasant
        elif val <= threshold_unpleasant:
            amp = amp_unpleasant
            freq = freq_unpleasant

        # Divide and deform
        t_vals = crv.DivideByCount(int(divs), True)
        if not t_vals:
            continue

        points = []
        for i, t in enumerate(t_vals):
            pt = crv.PointAt(t)
            vec = pt - center
            if vec.IsTiny():
                continue
            vec.Unitize()

            # Perlin-style deformation
            noise_val = perlin1d(i * freq + z * 0.03) * amp
            new_pt = pt + vec * noise_val
            points.append(new_pt)

        if len(points) > 1:
            interp = rg.Curve.CreateInterpolatedCurve(points + [points[0]], 3)
            interp.Translate(rg.Vector3d(0, 0, z))
            deformed_curves.append(interp)

    a = deformed_curves
# ---------- end python ----------
loft_2 = Loft(Curves=python.a, Options={Adjust=False, Closed=False, LoftEnds=0, LoftSimp=0, LoftType=0, Rebuild=10, Refit=0.01})
cap_2 = CapHoles(Brep=loft_2)
# 把外面生成的shape切掉里面的shape，剩下一个壳子，光照进去可以看到里面的valence data visulization
sdiff = SolidDifference(BrepsA=cap, BrepsB=cap_2)
