# Grasshopper definition ghtest02.gh (Grasshopper 1.0.8)

# ----
# STEP 1:
# Python file: valence-arosal timeline csv file are linked here
sudden_angry = FilePath("/Users/sijiama/Documents/GitHub/Machine_Aesthetics/audio_analysis/machine_ase/luminote/valence_arousal_timeline-sudden-angry.csv")
_2_screams = FilePath("/Users/sijiama/Documents/GitHub/Machine_Aesthetics/audio_analysis/machine_ase/luminote/valence_arousal_timeline-screams.csv")
sobbing = FilePath("/Users/sijiama/Documents/GitHub/Machine_Aesthetics/audio_analysis/machine_ase/luminote/valence_arousal_timeline-sobbing.csv")

# ----
# toggle the steps the see the animation changes of the lamp building from bottom to top
steps = Slider(40, range=0..40)

file = ReadFile(File=sobbing, PerLineParse=True)

# ----
# Old Design Version, Ignore
height = Slider(2, range=0..3)
joy = Curve(<curve referenced from the Rhino model>)
series = Series(Start="0", Step=height, Count=steps)
Z = UnitZ(Factor=series)
multiplication = Multiplication(A=Z, B=series)
move = Move(Geometry=joy, Motion=multiplication)  # -> Geometry, Transform
py3 = Python3Script(lines=file)  # -> out, a; inputs lines: list
# ---------- py3: Python ----------
arousal_values = []

for i, line in enumerate(lines):
    if i == 0:
        continue  # skip header

    parts = line.strip().split(",")
    
    if len(parts) == 3:
        try:
            arousal = float(parts[2])
            arousal_values.append(arousal)
        except:
            continue  # skip invalid values

a = arousal_values
# ---------- end py3 ----------
py3_2 = Python3Script(
    base_crv=joy,
    scale=Slider(11, range=0..20),
    arousal=py3.a,
    z_vals=series,
    noise_amp=Slider(0.784, range=0..20),
    noise_freq=Slider(0.13, range=0..1),
    divs=Slider(60, range=0..60))  # -> out, a; inputs arousal: list, z_vals: list
# ---------- py3_2: Python ----------
import Rhino.Geometry as rg
import math
import rhinoscriptsyntax as rs

crv_geom = rs.coercecurve(base_crv)  # Convert Guid to Rhino.Geometry.Curve

# Simple fake Perlin-style 1D noise function
def perlin1d(x):
    return math.sin(x * 1.73) * math.sin(x * 0.47 + 2)

deformed_curves = []

# Check for valid input
if not z_vals or not arousal or base_crv is None:
    a = []
else:
    for idx, z in enumerate(z_vals):
        if idx >= len(arousal):
            break

        base_radius = float(arousal[idx]) * scale
        crv = crv_geom.DuplicateCurve()
        center = rg.AreaMassProperties.Compute(crv).Centroid

        # Scale from center
        scale_xform = rg.Transform.Scale(center, base_radius)
        crv.Transform(scale_xform)

        # Divide the curve
        t_vals = crv.DivideByCount(int(divs), True)
        if not t_vals:
            continue

        points = []
        for i, t in enumerate(t_vals):
            pt = crv.PointAt(t)
            vec = pt - center
            if vec.IsTiny(): continue
            vec.Unitize()

            # Perlin noise-style deformation
            noise_val = perlin1d(i * noise_freq + z * 0.03) * noise_amp
            new_pt = pt + vec * noise_val
            points.append(new_pt)

        if len(points) > 2:
            # Create interpolated curve and close it
            interp = rg.Curve.CreateInterpolatedCurve(points + [points[0]], 3)

            if interp and interp.IsValid:
                # Explicitly make sure it's closed
                if not interp.IsClosed:
                    interp.MakeClosed(0.001)

                # Rebuild the curve for consistent lofting structure
                interp_nurbs = interp.ToNurbsCurve()
                success = interp_nurbs.Rebuild(10, 3, False)
                if success:
                    interp = interp_nurbs  # assign the rebuilt NurbsCurve back

                # Stack vertically in z direction
                interp.Translate(rg.Vector3d(0, 0, z))

                # Append to list
                deformed_curves.append(interp)

    # Optional: Align curve orientations to avoid loft errors
    for i in range(1, len(deformed_curves)):
        if rg.Curve.ClosedCurveOrientation(deformed_curves[i], rg.Plane.WorldXY) != rg.CurveOrientation.Clockwise:
            deformed_curves[i].Reverse()

    for i, c in enumerate(deformed_curves):
      print(f"Curve {i}: Valid={c.IsValid}, Closed={c.IsClosed}, Planar={c.IsPlanar()}, Degree={c.Degree}, Points={c.Points.Count}")

    a = deformed_curves  # Output
# ---------- end py3_2 ----------
loft = Loft(Curves=py3_2.a, Options={Adjust=False, Closed=False, LoftEnds=0, LoftSimp=0, LoftType=0, Rebuild=10, Refit=0.01})
panel = Panel(py3_2.a)
offset = OffsetCurve(Curve=py3_2.a, Distance="1", Corners=1)
cap = CapHoles(Brep=loft)

python = Python3Script(lines=file, y=file)  # -> out, v, a; inputs lines: list
# ---------- python: Python ----------
arousal_values = []
valence_values = []

for i, line in enumerate(lines):
    if i == 0:
        continue  # skip header

    parts = line.strip().split(",")
    
    if len(parts) == 3:
        try:
            valence = float(parts[1])
            arousal = float(parts[2])
            valence_values.append(valence)
            arousal_values.append(arousal)
        except:
            continue  # skip invalid values

a = arousal_values
v = valence_values
# ---------- end python ----------
panel_2 = Panel(python.v)
panel_3 = Panel(python.a)
steps_2 = Slider(100, range=0..100)
height_2 = Slider(10, range=0..10)
height_3 = Slider(4.05, range=0..10)
height_4 = Slider(-0.58, range=-10..10)
# STEP 2:
# Base Shape Design Based On Valence and Arousal Data
height_5 = Slider(1.082, range=0..10)
step = Slider(2, range=0..2)
steps_3 = Slider(19.267, range=0..20)
py3_3 = Python3Script(
    freq_scale=height_5,
    amp_scale=height_3,
    squareness=height_4,
    val=python.v,
    aro=python.a,
    res=steps_2,
    step=step,
    num_curves=steps_3,
    base_radius=height_2)  # -> out, a; inputs squareness: Double, val: list of Double, aro: list of Double, res: Int32, num_curves: Int32
# ---------- py3_3: Python ----------
import math
import Rhino.Geometry as rg

curves = []

def generate_emotional_shape(val, aro, res, base_radius, z_offset, amp_scale, freq_scale, squareness):
    points = []

    # Map arousal to amplitude (energy)
    amp = aro * amp_scale

    # Map valence to frequency (emotional tone)
    freq = abs(val) * freq_scale

    # If valence is negative, shape becomes square-biased
    square_factor = max(0, -val) * squareness  # Only active for negative valence

    for i in range(res):
        t = i / float(res)
        angle = 2 * math.pi * t

        # Base circular radius
        r = base_radius + amp * math.sin(angle * freq)

        # Add square-like bias if valence is negative
        r *= 1 + square_factor * math.cos(angle * 2)

        x = r * math.cos(angle)
        y = r * math.sin(angle)

        pt = rg.Point3d(x, y, z_offset)
        points.append(pt)

    points.append(points[0])  # close the loop
    return rg.Polyline(points).ToNurbsCurve()

# Loop through frames
for n in range(min(num_curves, len(val))):
    v = val[n]
    a = aro[n]
    z = n * step

    curve = generate_emotional_shape(
        v, a, res, base_radius, z,
        amp_scale, freq_scale, squareness
    )
    curves.append(curve)

a = curves
# ---------- end py3_3 ----------
loft_2 = Loft(Curves=py3_3.a, Options={Adjust=False, Closed=False, LoftEnds=0, LoftSimp=0, LoftType=0, Rebuild=10, Refit=0.01})
cap_2 = CapHoles(Brep=loft_2)
mesh = MeshBrep(
    Brep=cap_2,
    Settings={GridMaxCount=0, GridMinCount=16, JaggedSeams=False, MaxEdgeLength=0, MinEdgeLength=0.0001, MinTolerance=0, Refine=True, RefineAngle=0, RelativeTolerance=0.65, SimplePlanes=True, Tolerance=0})
py3_4 = Python3Script(mesh=mesh)  # -> out, a
# ---------- py3_4: Python ----------
import rhinoscriptsyntax as rs
import json
import os

# Replace this with your actual export path
file_path = "/Users/sijiama/Documents/GitHub/Machine_Aesthetics/shape_api/shape.json"

# Convert GUID to Rhino mesh object
gh_mesh = rs.coercemesh(mesh)

if gh_mesh:
    vertices = [[v.X, v.Y, v.Z] for v in gh_mesh.Vertices]
    faces = []

    for i in range(gh_mesh.Faces.Count):
        f = gh_mesh.Faces[i]
        if f.IsTriangle:
            faces.append([f.A, f.B, f.C])
        elif f.IsQuad:
            faces.append([f.A, f.B, f.C, f.D])

    data = {"vertices": vertices, "faces": faces}

    with open(file_path, "w") as f:
        json.dump(data, f)

    a = "✅ shape.json exported!"
else:
    a = "❌ Could not read mesh input"
# ---------- end py3_4 ----------
