# Grasshopper definition ghtest01.gh (Grasshopper 1.0.8)

# ----
# toggle the steps the see the animation changes of the lamp building from bottom to top
steps = Slider(40, range=0..40)

height = Slider(2, range=0..3)
# Each Emotion Are given a predefined base_crv, which are plugged into the python file to generate shape
affection = Curve(<curve referenced from the Rhino model>)
calmness = Curve(<curve referenced from the Rhino model>)
joy = Curve(<curve referenced from the Rhino model>)
pride = Curve(<curve referenced from the Rhino model>)
fear = Curve(<curve referenced from the Rhino model>)
sadness = Curve(<curve referenced from the Rhino model>)
disgust = Curve(<curve referenced from the Rhino model>)

# ----
# Python file: valence-arosal timeline csv file are linked here
path = FilePath("/Users/sijiama/Desktop/MachineAes/luminote/valence_arousal_timeline.csv")

series = Series(Start="0", Step=height, Count=steps)
Z = UnitZ(Factor=series)
multiplication = Multiplication(A=Z, B=series)
move = Move(Geometry=joy, Motion=multiplication)  # -> Geometry, Transform
file = ReadFile(File=path, PerLineParse=True)
py3 = Python3Script(lines=file)  # -> out, a; inputs lines: list
# ---------- py3: Python ----------
arousal_values = []

for i, line in enumerate(lines):
    if i == 0:
        continue  # skip header

    parts = line.strip().split(",")
    
    if len(parts) == 3:
        try:
            arousal = float(parts[2])
            arousal_values.append(arousal)
        except:
            continue  # skip invalid values

a = arousal_values
# ---------- end py3 ----------
panel = Panel(py3.a)
py3_2 = Python3Script(
    base_crv=joy,
    scale=Slider(11, range=0..20),
    arousal=py3.a,
    z_vals=series,
    noise_amp=Slider(0.784, range=0..20),
    noise_freq=Slider(0.13, range=0..1),
    divs=Slider(60, range=0..60))  # -> out, a; inputs arousal: list, z_vals: list
# ---------- py3_2: Python ----------
import Rhino.Geometry as rg
import math
import rhinoscriptsyntax as rs

crv_geom = rs.coercecurve(base_crv)  # Convert Guid to Rhino.Geometry.Curve

# Simple fake Perlin-style 1D noise function
def perlin1d(x):
    return math.sin(x * 1.73) * math.sin(x * 0.47 + 2)

deformed_curves = []

# Check for valid input
if not z_vals or not arousal or base_crv is None:
    a = []
else:
    for idx, z in enumerate(z_vals):
        if idx >= len(arousal):
            break

        base_radius = float(arousal[idx]) * scale
        crv = crv_geom.DuplicateCurve()
        center = rg.AreaMassProperties.Compute(crv).Centroid

        # Scale from center
        scale_xform = rg.Transform.Scale(center, base_radius)
        crv.Transform(scale_xform)

        # Divide the curve
        t_vals = crv.DivideByCount(int(divs), True)
        if not t_vals:
            continue

        points = []
        for i, t in enumerate(t_vals):
            pt = crv.PointAt(t)
            vec = pt - center
            if vec.IsTiny(): continue
            vec.Unitize()

            # Perlin noise-style deformation
            noise_val = perlin1d(i * noise_freq + z * 0.03) * noise_amp
            new_pt = pt + vec * noise_val
            points.append(new_pt)

        if len(points) > 2:
            # Create interpolated curve and close it
            interp = rg.Curve.CreateInterpolatedCurve(points + [points[0]], 3)

            if interp and interp.IsValid:
                # Explicitly make sure it's closed
                if not interp.IsClosed:
                    interp.MakeClosed(0.001)

                # Rebuild the curve for consistent lofting structure
                interp_nurbs = interp.ToNurbsCurve()
                success = interp_nurbs.Rebuild(10, 3, False)
                if success:
                    interp = interp_nurbs  # assign the rebuilt NurbsCurve back

                # Stack vertically in z direction
                interp.Translate(rg.Vector3d(0, 0, z))

                # Append to list
                deformed_curves.append(interp)

    # Optional: Align curve orientations to avoid loft errors
    for i in range(1, len(deformed_curves)):
        if rg.Curve.ClosedCurveOrientation(deformed_curves[i], rg.Plane.WorldXY) != rg.CurveOrientation.Clockwise:
            deformed_curves[i].Reverse()

    for i, c in enumerate(deformed_curves):
      print(f"Curve {i}: Valid={c.IsValid}, Closed={c.IsClosed}, Planar={c.IsPlanar()}, Degree={c.Degree}, Points={c.Points.Count}")

    a = deformed_curves  # Output
# ---------- end py3_2 ----------
loft = Loft(Curves=py3_2.a, Options={Adjust=False, Closed=False, LoftEnds=0, LoftSimp=0, LoftType=0, Rebuild=10, Refit=0.01})
panel_2 = Panel(py3_2.a)
offset = OffsetCurve(Curve=py3_2.a, Distance="1", Corners=1)
cap = CapHoles(Brep=loft)
mesh = MeshBrep(
    Brep=cap,
    Settings={GridMaxCount=0, GridMinCount=16, JaggedSeams=False, MaxEdgeLength=0, MinEdgeLength=0.0001, MinTolerance=0, Refine=True, RefineAngle=0, RelativeTolerance=0.65, SimplePlanes=True, Tolerance=0})
py3_3 = Python3Script(x=mesh)  # -> out, a
# ---------- py3_3: Python ----------
a = "🔥 Python component is running!"
# ---------- end py3_3 ----------
